# Grasshopper definition animation.gh (Grasshopper 1.0.8)

file_path = FilePath(["C:\BACKUP\Playdata\202105_lab\02.git\wave-function-collapse\wfc\output\2\0.obj", "C:\BACKUP\Playdata\202105_lab\02.git\wave-function-collapse\wfc\output\2\1.obj", "C:\BACKUP\Playdata\202105_lab\02.git\wave-function-collapse\wfc\output\2\2.obj", "C:\BACKUP\Playdata\202105_lab\02.git\wave-function-collapse\wfc\output\2\3.obj", "C:\BACKUP\Playdata\202105_lab\02.git\wave-function-collapse\wfc\output\2\4.obj", "C:\BACKUP\Playdata\202105_lab\02.git\wave-function-collapse\wfc\output\2\5.obj", "C:\BACKUP\Playdata\202105_lab\02.git\wave-function-collapse\wfc\output\2\6.obj", "C:\BACKUP\Playdata\202105_lab\02.git\wave-function-collapse\wfc\output\2\7.obj", "C:\BACKUP\Playdata\202105_lab\02.git\wave-function-collapse\wfc\output\2\8.obj", "C:\BACKUP\Playdata\202105_lab\02.git\wave-function-collapse\wfc\output\2\9.obj", "C:\BACKUP\Playdata\202105_lab\02.git\wave-function-collapse\wfc\output\2\10.obj", "C:\BACKUP\Playdata\202105_lab\02.git\wave-function-collapse\wfc\output\2\11.obj", "C:\BACKUP\Playdata\202105_lab\02.git\wave-function-collapse\wfc\output\2\12.obj", "C:\BACKUP\Playdata\202105_lab\02.git\wave-function-collapse\wfc\output\2\13.obj", "C:\BACKUP\Playdata\202105_lab\02.git\wave-function-collapse\wfc\output\2\14.obj", "C:\BACKUP\Playdata\202105_lab\02.git\wave-function-collapse\wfc\output\2\15.obj", "C:\BACKUP\Playdata\202105_lab\02.git\wave-function-collapse\wfc\output\2\16.obj", "C:\BACKUP\Playdata\202105_lab\02.git\wave-function-collapse\wfc\output\2\17.obj", "C:\BACKUP\Playdata\202105_lab\02.git\wave-function-collapse\wfc\output\2\18.obj", "C:\BACKUP\Playdata\202105_lab\02.git\wave-function-collapse\wfc\output\2\19.obj", "C:\BACKUP\Playdata\202105_lab\02.git\wave-function-collapse\wfc\output\2\20.obj", "C:\BACKUP\Playdata\202105_lab\02.git\wave-function-collapse\wfc\output\2\21.obj"])
python_3_script = Python3Script(objs=file_path, i=Slider(21, range=0..21))  # -> out, a; inputs objs: list, i: Int32
# ---------- python_3_script: Python ----------
import rhinoscriptsyntax as rs
import scriptcontext as sc
import Rhino
import os

STICKY_KEY = "gh_obj_import_guids"

def delete_previous():
    guids = sc.sticky.get(STICKY_KEY, None)
    if not guids:
        return

    for g in guids:
        if rs.IsObject(g):
            rs.DeleteObject(g)

    sc.sticky[STICKY_KEY] = []

def import_obj(filepath):
    if not filepath:
        return "No path provided."

    if not os.path.isfile(filepath):
        return "File not found: {}".format(filepath)

    gh_doc = sc.doc
    sc.doc = Rhino.RhinoDoc.ActiveDoc

    try:
        delete_previous()

        before = set(rs.AllObjects(select=False))

        cmd = '-_Import "{}" _Enter'.format(filepath)
        ok = rs.Command(cmd, echo=False)

        if not ok:
            return "Import failed."

        rs.UnselectAllObjects()

        after = set(rs.AllObjects(select=False))
        new_objs = list(after - before)

        # ---- 여기에서 translation 적용 (250, 0, 0) ----
        move_vec = (250.0, 0.0, 0.0)
        for g in new_objs:
            if rs.IsObject(g):
                rs.MoveObject(g, move_vec)

        sc.sticky[STICKY_KEY] = new_objs

        return "Import + translate complete. {} object(s) loaded.".format(len(new_objs))

    finally:
        sc.doc = gh_doc

msg = import_obj(objs[i])
a = msg
# ---------- end python_3_script ----------
